# Grasshopper definition load_data.gh (Grasshopper 1.0.7)
# Copyright: Job de Vogel

# Augmentation of pointclouds and vectors
# 
# 110: wrong roof, C:\Users\Job de Vogel\OneDrive\Documenten\TU Delft\Master Thesis\Dataset_pipeline\dataset\data\geometry\3dbag_v210908_fd2cee53_lod12_3d_5859\mesh_328_rot3.json
# 
# 2: some weird points at building intersections give 0 irradiance value C:\Users\Job de Vogel\OneDrive\Documenten\TU Delft\Master Thesis\Dataset_pipeline\dataset\data\geometry\3dbag_v210908_fd2cee53_lod12_3d_5859\mesh_100_rot3.json
# 
# This also seems to happen sometimes in vertical edges
# C:\\Users\\Job de Vogel\\OneDrive\\Documenten\\TU Delft\\Master Thesis\\Dataset_pipeline\\dataset\\data_temp\\geometry
button = Button()
boolean_toggle = BooleanToggle(True)  # disabled
boolean_toggle_2 = BooleanToggle(False)  # disabled
boolean_toggle_3 = BooleanToggle(True)  # disabled
boolean_toggle_4 = BooleanToggle(True)  # disabled
file_path = FilePath("C:\Users\Job de Vogel\OneDrive\Documenten\TU Delft\Master Thesis\Dataset_pipeline\3D_BAG_dataset\9-324-520-LoD12-3D.obj")  # disabled
data_recorder = DataRecorder(button, DataLimit=1000, RecordData=True)
python_script = PythonScript(
    File_Paths=file_path,
    Translate=boolean_toggle_3,
    Level_Ground=boolean_toggle_4,
    parallel=boolean_toggle_2,
    run=boolean_toggle)  # -> out, mesh, local_meshes, roof_meshes, wall_meshes, bbox; inputs File_Paths: list; disabled
# ---------- python_script: Python ----------
import Rhino.Geometry as rg
from ghpythonlib import parallel
from ghpythonlib import treehelpers

import warnings
import sys

def load_obj(path):
    with open(path) as file:
        lines = file.readlines()
    
    vertices=[]
    faces=[]
    
    for line in lines:
        if line.find("v")==0 and line.find("n")==-1 and line.find("t")==-1:
            vertices.Add(rg.Point3d(float((line.split(' '))[1]),float((line.split(' '))[2]),float((line.split(' '))[3])))
        if line.find("f")==0:
            if line.split(' ').Count==4:
                faces.Add(rg.MeshFace(int(line.split(' ')[1].split('/')[0])-1,int(line.split(' ')[2].split('/')[0])-1,int(line.split(' ')[3].split('/')[0])-1))
            if line.split(' ').Count==5:
                faces.Add(rg.MeshFace(int(line.split(' ')[1].split('/')[0])-1,int(line.split(' ')[2].split('/')[0])-1,int(line.split(' ')[3].split('/')[0])-1,int(line.split(' ')[4].split('/')[0])-1))
    
    mesh = rg.Mesh()
    for vertex in vertices:
        mesh.Vertices.Add(vertex)
    
    for face in faces:
        mesh.Faces.AddFace(face)
    
    mesh.Normals.ComputeNormals()
    mesh.Compact()
    mesh.MergeAllCoplanarFaces(0.01)
    
    return mesh

def translate_mesh(mesh, bbox):
    center = bbox.Center
    x, y = center[0], center[1]

    mesh.Translate(-x, -y, 0)
    brepBoundingBox = bbox.ToBrep()
    brepBoundingBox.Translate(-x, -y, 0)
    
    return mesh, brepBoundingBox

def get_bbox(mesh):
    xyPlane = rg.Plane(rg.Point3d(0.0, 0.0, 0.0), rg.Vector3d(0.0, 0.0, 1.0))
    boundingBox = mesh.GetBoundingBox(xyPlane)
    
    return boundingBox

def partition_mesh(mesh):
    roofMesh = rg.Mesh()
    roofMesh.CopyFrom(mesh)
    roofFacesIdxs = []
    
    wallMesh = rg.Mesh()
    wallMesh.CopyFrom(mesh)
    wallFacesIdxs = []
    
    floorMesh = rg.Mesh()
    floorMesh.CopyFrom(mesh)
    floorFacesIdxs = []
    
    for i, normal in enumerate(mesh.FaceNormals):
        if normal.Z > 0:
            roofFacesIdxs.append(i)
        elif normal.Z == 0:
            wallFacesIdxs.append(i)
        else:
            floorFacesIdxs.append(i)
    
    valid = True
    if len(floorFacesIdxs) == 0 or len(wallFacesIdxs) == 0 or len(roofFacesIdxs) == 0:
        valid = False
        warnings.warn("File contains meshes without roofs, walls or floors.")
        
        return valid, roofMesh, wallMesh, floorMesh
        
    roofMesh.Faces.DeleteFaces(wallFacesIdxs + floorFacesIdxs)
    wallMesh.Faces.DeleteFaces(roofFacesIdxs + floorFacesIdxs)
    floorMesh.Faces.DeleteFaces(roofFacesIdxs + wallFacesIdxs)
    
    roofMesh.Compact()
    wallMesh.Compact()
    floorMesh.Compact()
    
    return valid, roofMesh, wallMesh, floorMesh

def level_mesh(mesh, roof_mesh, wall_mesh, floor_mesh):
    height = floor_mesh.Faces.GetFaceCenter(0).Z
    
    mesh.Translate(0, 0, -height)
    roof_mesh.Translate(0, 0, -height)
    wall_mesh.Translate(0, 0, -height)
    floor_mesh.Translate(0, 0, -height)
    
    return mesh, roof_mesh, wall_mesh, floor_mesh

def main(path):
    mesh = load_obj(path)
    
    if Translate:
        mesh, bbox = translate_mesh(mesh, get_bbox(mesh))
    else:
        bbox = get_bbox(mesh)
    
    if Level_Ground:
        global_mesh = rg.Mesh()
    else:
        global_mesh = mesh

    local_meshes = []
    local_roof_meshes = []
    local_wall_meshes = []
    local_floor_meshes = []
    
    for i, local_mesh in enumerate(mesh.SplitDisjointPieces()):
        valid, roof_mesh, wall_mesh, floor_mesh = partition_mesh(local_mesh)
        
        if not valid:
            continue
        
        if Level_Ground:
            local_mesh, roof_mesh, wall_mesh, floor_mesh = level_mesh(local_mesh, roof_mesh, wall_mesh, floor_mesh)
            global_mesh.Append(local_mesh)
        
        local_meshes.append(local_mesh)
        local_roof_meshes.append(roof_mesh)
        local_wall_meshes.append(wall_mesh)
        local_floor_meshes.append(floor_mesh)

    return mesh, local_meshes, local_roof_meshes, local_wall_meshes, local_floor_meshes, bbox

if __name__ == '__main__':
    if run:
        if parallel:
            if len(File_Paths) == 1:
                mesh, local_meshes, roof_meshes, wall_meshes, floor_meshes, bbox = main(File_Paths[0])
            else:
                results = parallel.run(main, File_Paths, False)
                mesh, local_meshes, roof_meshes, wall_meshes, floor_meshes, bbox = list(zip(*results))
                
                mesh = treehelpers.list_to_tree(mesh, source=[0])
                local_meshes = treehelpers.list_to_tree(local_meshes, source=[0])
                roof_meshes = treehelpers.list_to_tree(roof_meshes, source=[0])
                wall_meshes = treehelpers.list_to_tree(wall_meshes, source=[0])
                floor_meshes = treehelpers.list_to_tree(floor_meshes, source=[0])
                bbox = treehelpers.list_to_tree(bbox, source=[0])
        else:
            if len(File_Paths) == 1:
                mesh, local_meshes, roof_meshes, wall_meshes, floor_meshes, bbox = main(File_Paths[0])
            else:
                mesh = []
                local_meshes = []
                roof_meshes = []
                wall_meshes = []
                floor_meshes = []
                bbox = []
                for file in File_Paths:
                    tmp_mesh, tmp_local_meshes, tmp_roof_meshes, tmp_wall_meshes, tmp_floor_meshes, tmp_bbox = main(file)
                    mesh.append(tmp_mesh)
                    local_meshes.append(tmp_local_meshes)
                    roof_meshes.append(tmp_roof_meshes)
                    wall_meshes.append(tmp_wall_meshes)
                    floor_meshes.append(tmp_floor_meshes)
                    bbox.append(tmp_bbox)
                
                mesh = treehelpers.list_to_tree(mesh, source=[0])
                local_meshes = treehelpers.list_to_tree(local_meshes, source=[0])
                roof_meshes = treehelpers.list_to_tree(roof_meshes, source=[0])
                wall_meshes = treehelpers.list_to_tree(wall_meshes, source=[0])
#                floor_meshes = treehelpers.list_to_tree(floor_meshes, source=[0])
                bbox = treehelpers.list_to_tree(bbox, source=[0])
# ---------- end python_script ----------
minimum_coverage = Slider(25, range=0..100)  # disabled
envelope_size = Slider(100, range=0..1000)  # disabled
trigger = Trigger(Interval=5000, TimerInterval=5000, Target=ghpython_script)
list_length = ListLength(List=data_recorder)  # -> expr("x/2", Length)
panel = Panel(list_length)
ghpython_script = GhPythonScript()  # -> out, idx, path, aug, name, meshes, points, irradiance, visualization, meta
# ---------- ghpython_script: Python ----------
__author__ = "Job de Vogel"
__version__ = "2023.07.26"

import Rhino.Geometry as rg
import ghpythonlib.treehelpers as th
import json

import glob
import os

# Load a mesh from a json file
def load_mesh_from_json(path):
#    path = folder + "/" + name + ".json"
    with open(path, "r") as file:
        data = json.load(file)

    meta = data['meta']
    data.pop('meta')
    meshes = []
    
    visualization = None
    
    for key in data.keys():
        mesh = rg.Mesh.FromJSON(data[key])
        
        if key == 'visualization':
            visualization = mesh
        else:
            meshes.append(mesh)
    
    return meshes, meta, visualization

def load_array_as_list(path):
    with open(path, 'r') as file:
        data = json.load(file)
    
    data = json.loads(data)
        
    # with open(file, 'rb') as file:
    #     data = pickle.load(file)
    
    return data

# Load a mesh from a json file
def load_outlines_from_json(path):
    with open(path, "r") as file:
        data = json.load(file)

    curves = []
    for key in data.keys():
        curves.append(rg.NurbsCurve.FromJSON(data[key]))

    return curves

def get_latest_file(dir):
    files = os.listdir(dir)
    paths = [os.path.join(dir, basename) for basename in files]
    print(files)
    latest_file = max(paths, key=os.path.getctime)
    
    return latest_file, paths

def main():
    path = 'C:\\Users\\Job de Vogel\\OneDrive\\Documenten\\TU Delft\\Master Thesis\\Dataset_pipeline\\dataset\\data\\geometry'
    
    if overwrite_folder != None:
        path = overwrite_folder
    
    subfolders = []
    for file in os.listdir(path):
        d = os.path.join(path, file)
        if os.path.isdir(d):
            subfolders.append(d)
    
    latest_files = []
    all_files = []

    for folder in subfolders:
        latest_file, files = get_latest_file(folder)
        all_files.extend(files)
        latest_files.append(latest_file)
    
    
    
    if index != None:
        latest_file = all_files[int(index)]
    else:
        latest_file = max(latest_files, key=os.path.getctime)
    
    name = latest_file.split("\\")[-1]
    idx = int(name[5:-10])
    aug = name[-9:-5]
    
    if aug == 'base':
        aug = 0
    else:
        aug = int(aug[-1])
    
    irr_path = latest_file.replace('geometry', 'irradiance').replace('mesh', 'sensors')
    
    meshes, meta, visualization = load_mesh_from_json(latest_file)
    irradiance = load_array_as_list(irr_path)
    irr_flipped = list(zip(*irradiance))
    
    points = [rg.Point3d(x, y, z) for x, y, z in zip(irr_flipped[0], irr_flipped[1], irr_flipped[2])]
    irradiance = irr_flipped[6]

    meshes = th.list_to_tree(meshes)
    
    path = latest_file
    
    return meshes, points, irradiance, meta, visualization, idx, aug, name, path

meshes, points, irradiance, meta, visualization, idx, aug, name, path = main()
# ---------- end ghpython_script ----------
list_item = ListItem(List=ghpython_script.meshes, Index=0, Wrap=True)
number_slider = Slider(0, range=0..100)
colour_swatch = ColourSwatch(SwatchColor=RGBA(181, 0, 0, 65))  # disabled
data = Data(python_script.mesh)  # disabled
ghpython_script_2 = GhPythonScript(bbox=python_script.bbox, size=envelope_size, min_coverage=minimum_coverage)  # -> out, ground_outlines; inputs bbox: Box; disabled
# ---------- ghpython_script_2: Python ----------
__author__ = "Job de Vogel"
__version__ = "2023.04.25"

import Rhino.Geometry as rg
import random

# Get the x,y domain of a bbox
def get_domain(bbox):
    print(bbox.GetCorners())
    x, y, _ = list(map(list, zip(*bbox.GetCorners())))
    print('\n')
    print(x,y)
    
    min_x = min(x)
    min_y = min(y)
    max_x = max(x)
    max_y = max(y)
    
    return (min_x, max_x), (min_y, max_y)

# Divide main domain into sub domains
def divide_domain(domain, size, min_coverage):
    min_x, max_x = domain[0]
    min_y, max_y = domain[1]
    
    x_size = abs(min_x) + abs(max_x)
    y_size = abs(min_y) + abs(max_y)
    
    step_size = size * min_coverage / 100
    x_steps = (x_size // step_size) - 1
    y_steps = (y_size // step_size) - 1
    
    sub_domains = []
    for i in range(int(x_steps)):
        for j in range(int(y_steps)):
            x_domain = (min_x + i * step_size, min_x + i * step_size + size)
            y_domain = (min_y + j * step_size, min_y + j * step_size + size)
            
            sub_domains.append((x_domain, y_domain))
    
    return sub_domains

# Generate bbox from domain and size
def create_bbox(domain, bottom_treshold):
    x_domain, y_domain = domain
    x_center = (x_domain[0] + x_domain[1]) / 2
    y_center = (y_domain[0] + y_domain[1]) / 2
    
    size = abs(x_domain[1] - x_domain[0])
    
    center = rg.Point3d(x_center, y_center, 0)
    plane = rg.Plane(center, rg.Vector3d(0, 0, 1))
    
    interv = rg.Interval(-0.5 * size, 0.5 * size)
    z_interv = rg.Interval(-0.1, size + 0.1)

    box = rg.Box(plane, interv, interv, z_interv)
    return box

def main():
    main_domain = get_domain(bbox)
    sub_domains = divide_domain(main_domain, size, min_coverage)
    
    outlines = []
    for domain in sub_domains:
        corner_0 = rg.Point3d(domain[0][0], domain[1][0], 0)
        corner_1 = rg.Point3d(domain[0][1], domain[1][1], 0)
        outlines.append(rg.Rectangle3d(rg.Plane.WorldXY, corner_0, corner_1))

    return outlines

ground_outlines = main()
# ---------- end ghpython_script_2 ----------
disjoint_mesh = DisjointMesh(Mesh=list_item)
list_item_2 = ListItem(List=disjoint_mesh, Index=0, Wrap=True)
panel_2 = Panel(ghpython_script.path)
mesh_edges = MeshEdges(Mesh=python_script.local_meshes)  # -> NakedEdges, InteriorEdges, NonManifoldEdges; disabled
remap_numbers = RemapNumbers(Value=ghpython_script.irradiance, Source=Domain(0, 1000), Target=Domain(0, 1))  # -> Mapped, Clipped

mesh_join = MeshJoin(Meshes=ghpython_script.meshes)
number_slider_2 = Slider(10000, range=0..20000)  # disabled
deconstruct_mesh = DeconstructMesh(Mesh=mesh_join)  # -> Vertices, Faces, Colours, Normals; disabled
list_length_2 = ListLength(List=deconstruct_mesh.Faces)  # disabled
# Base Pointnet Architecture input
subtraction = Subtraction(A=list_length_2, B=number_slider_2)  # disabled
random_reduce = RandomReduce(List=deconstruct_mesh.Faces, Reduction=subtraction, Seed=1)  # disabled
construct_mesh = ConstructMesh(Vertices=deconstruct_mesh.Vertices, Faces=random_reduce)  # disabled

number_slider_3 = Slider(0, range=0..20)
list_item_3 = ListItem(List=ghpython_script_2.ground_outlines, Index=ghpython_script.idx, Wrap=True)  # disabled
colour_swatch_2 = ColourSwatch(SwatchColor=RGB(255, 255, 255))  # disabled
custom_preview = CustomPreview(Geometry=data, Material=colour_swatch)  # disabled
gradient = Gradient(
    LowerLimit=0,
    UpperLimit=1,
    Parameter=remap_numbers.Mapped,
    stops=[0: RGB(0, 0, 0), 0.249: RGB(173, 203, 249), 0.5: RGB(254, 244, 84), 0.746: RGB(234, 126, 0), 1: RGB(234, 38, 0)])
ghpython_script_3 = GhPythonScript()  # -> out, a; inputs x: Polyline
# ---------- ghpython_script_3: Python ----------
__author__ = "Job de Vogel"
__version__ = "2023.09.13"

import rhinoscriptsyntax as rs
import Rhino.Geometry as rg
import ghpythonlib.treehelpers as th

datas = [[(31.0, -27.814176559448242, -5.551115123125783e-17), (30.932199478149414, -28.0, 1.1102230246251565e-16), (30.90720558166504, -28.068498611450195, -5.551115123125783e-17), (30.932199478149414, -28.0, -5.551115123125783e-17), (31.0, -27.814176559448242, -5.551115123125783e-17)], [(-12.0,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

a = []
for data in datas:
    outline = rg.Polyline([rg.Point3d(pt[0], pt[1], pt[2]) for pt in data])
    a.append(outline)

a = th.list_to_tree(a, source=[0])
# ---------- end ghpython_script_3 ----------
custom_preview_2 = CustomPreview(Geometry=mesh_join, Material=ColourSwatch(SwatchColor=RGB(199, 163, 163)))
area = Area(Geometry=list_item_3)  # -> Area, Centroid; disabled
custom_preview_3 = CustomPreview(Geometry=mesh_edges.InteriorEdges, Material=colour_swatch_2)  # disabled
panel_3 = Panel(ghpython_script.out)
panel_4 = Panel("0,0,0")  # disabled
polyline = PolyLine(Vertices=ghpython_script_3.a, Closed=False)  # -> flatten(Polyline)
list_item_4 = ListItem(List=ghpython_script.meshes, Index=0, Wrap=True)
vector_2pt = Vector2Pt(PointA=panel_4, PointB=area.Centroid, Unitize=False)  # -> Vector, Length; disabled
list_item_5 = ListItem(List=polyline, Index=0, Wrap=True)
symbol_simple = SymbolSimple(Style=1, Size=3, Rotation=0, Colour=gradient)
colour_swatch_3 = ColourSwatch(SwatchColor=RGB(255, 255, 255))  # disabled
panel_5 = Panel(polyline)
number_slider_4 = Slider(1, range=0..10)  # disabled
ghpython_script_4 = GhPythonScript()  # -> out, mesh_plane, splitter, checkpoints, result; disabled
# ---------- ghpython_script_4: Python ----------
__author__ = "Job de Vogel"
__version__ = "2023.09.22"

import rhinoscriptsyntax as rs

import Rhino.Geometry as rg
import json

def load(path):
    with open(path) as file:
        data = json.load(file)
        
        decoded = []
        for d in data:
            decoded.append(rg.Mesh.FromJSON(d))
    
    return decoded
    
mesh_plane = load('C:\\Users\\Job de Vogel\\Desktop\\mesh_plane.json')
splitter = load('C:\\Users\\Job de Vogel\\Desktop\\splitter.json')

checkpoints = [(11.686354160308838, 13.075285196304321, 3.469446951953614e-17),
(-11.111438751220703, -10.268966674804688, -8.326672684688674e-17),
(0.0, 0.0, 0.0),
(-16.0174503326416, -8.239943981170654, -3.5128150388530344e-17),
(-19.014963150024414, -7.000235915184021, 3.491130995403324e-17),
(-17.040935516357422, -7.816651940345764, 9.020562075079397e-17),
(-20.314545154571533, -6.462756156921387, 5.551115123125783e-17),
(-23.06071949005127, -5.320987820625305, 2.168404344971009e-19),
(0.0, 0.0, 0.0),
(0.0, 0.0, 0.0),
(-26.02121353149414, -4.051523447036743, 7.37257477290143e-18),
(-24.82132625579834, -4.566036939620972, -1.3877787807814457e-17),
(-23.995434284210205, -4.920180678367615, 4.336808689942018e-19),
(-26.801869869232178, -3.716776490211487, 1.3877787807814457e-17),
(-12.332953453063965, -15.085617065429688, -4.163336342344337e-17),
(-15.008889198303223, -14.004119157791138, 2.0599841277224584e-17),
(-13.655453205108643, -14.551119565963745, -2.7755575615628914e-17),
(-17.454520225524902, -13.015699863433838, -1.0191500421363742e-17),
(-18.598774433135986, -12.553241491317749, 1.1123914289701275e-16),
(-22.122392654418945, -11.129146099090576, 0.0),
(-21.497607707977295, -11.381657361984253, 4.336808689942018e-19),
(0.0, 0.0, 0.0)]

checkpoints = [rg.Point3d(p[0],p[1],p[2]) for p in checkpoints]

result = mesh_plane[0].Split(splitter[0])
print([len(element.Faces) for element in result])
# ---------- end ghpython_script_4 ----------
custom_preview_4 = CustomPreview(Geometry=mesh_edges.InteriorEdges, Material=colour_swatch_3)  # disabled
vector = Vector(vector_2pt.Vector)  # disabled
symbol_display = SymbolDisplay(Location=ghpython_script.points, Display=symbol_simple)
data_2 = Data(ghpython_script_4.splitter)  # disabled
data_3 = Data(ghpython_script_4.result)  # disabled
point = Point(ghpython_script_4.checkpoints)  # disabled
area_2 = Area(Geometry=list_item_4)  # -> Area, Centroid
move = Move(Motion=vector)  # -> Geometry, Transform; disabled
list_item_6 = ListItem(List=point, Index=number_slider_4, Wrap=True)  # disabled
list_item_7 = ListItem(List=data_3, Index=number_slider_4, Wrap=True)  # disabled
data_4 = Data(ghpython_script.meshes)
list_item_8 = ListItem(List=data_4, Index=0, Wrap=True)  # -> Item, Item1, Item2
custom_preview_5 = CustomPreview(
    Geometry=list_item_8.Item,
    Material={diffuse=RGB(221, 160, 221), emission=RGB(66, 48, 66), shine=0.5, specular=RGB(255, 255, 255), transparency=0})
custom_preview_6 = CustomPreview(
    Geometry=list_item_8.Item1,
    Material={diffuse=RGB(221, 160, 221), emission=RGB(66, 48, 66), shine=0.5, specular=RGB(255, 255, 255), transparency=0})
custom_preview_7 = CustomPreview(
    Geometry=list_item_8.Item2,
    Material={diffuse=RGB(221, 160, 221), emission=RGB(66, 48, 66), shine=0.5, specular=RGB(255, 255, 255), transparency=0})
